% Simulink data dictionary PI_ObjectiveDD.sldd

Err = Simulink.Signal(StorageClass="ExportedGlobal", Alias="g_Err")
DiscIntegState = Simulink.Signal(StorageClass="Localizable")
InternalStoreMemory = Simulink.Signal(StorageClass="Localizable")
OutSig = Simulink.Signal(StorageClass="GetSet", Alias="myOutput", HeaderFile="myOutput.h", GetFunction="get_$N", SetFunction="set_$N")
Param_Kp = Simulink.Parameter(1, StorageClass="Const", Alias="myParam_Kp", HeaderFile="myParam.h", DefinitionFile="myParam.c")
Param_Ki = Simulink.Parameter(3, StorageClass="Const", Alias="myParam_Ki", HeaderFile="myParam.h", DefinitionFile="myParam.c")
Float32 = Simulink.AliasType(BaseType="single")

InputBus = Simulink.Bus(DataScope="Imported", HeaderFile="myInput.h")
  Req_Ctrl: Float32
  Feedback: Float32

PI_Ctrl = Simulink.Signal(StorageClass="ExportedGlobal", Alias="g_PI_Ctrl")
InSig = Simulink.Signal(StorageClass="Struct", Alias="myInput", StructName="myInputStuct", DataType="Bus: InputBus")